# Grasshopper definition xmlvaried.gh (Grasshopper 0.9.76)
# plug-ins: Python Interpreter, EleFront, gHowl, LunchBox

xml_test_data = CSharpScript()  # -> out, A; inputs x: Int32
# ---------- xml_test_data: C# ----------
    // Nearly all of this code started with examples posted by the fine folk helping each other at grasshopper3D.com.
    // (Afterwards, of course, it was mangled and modified to suit my particular purposes...)

    DataTree<System.Object> outTree = new DataTree<System.Object>();

    // Make trunk path and an empty branch path to modify later
    GH_Path trunk = new GH_Path(0); // {0}
    GH_Path branch = new GH_Path(); // {}
    GH_Path vpair = new GH_Path(); //{}
    Print("Trunk path: " + trunk.ToString());

    //menu
    outTree.Add("menu", trunk);

    //meal="breakfast"
    branch = trunk.AppendElement(0);
    outTree.Add("meal", branch);
    outTree.Add("breakfast", branch);

    //food
    branch = trunk.AppendElement(1);
    outTree.Add("food", branch);

    //<name>Belgian Waffles</name>
    vpair = branch.AppendElement(0);
    outTree.Add("name", vpair);
    outTree.Add("Belgian Waffles", vpair);

    //<price>$5.95</price>
    vpair = branch.AppendElement(1);
    outTree.Add("price", vpair);
    outTree.Add("$5.95", vpair);

    //<description>Two of our famous Belgian Waffles with plenty of real maple syrup</description>
    vpair = branch.AppendElement(2);
    outTree.Add("description", vpair);
    outTree.Add("Two of our famous Belgian Waffles with plenty of real maple syrup", vpair);

    //<calories>650</calories>
    vpair = branch.AppendElement(3);
    outTree.Add("calories", vpair);
    outTree.Add("650", vpair);
    
    //food
    branch = trunk.AppendElement(2);
    outTree.Add("food", branch);
    
    //<name>Strawberry Belgian Waffles</name>
    vpair = branch.AppendElement(0);
    outTree.Add("name", vpair);
    outTree.Add("Strawberry Belgian Waffles", vpair);

    //<price>$7.95</price>
    vpair = branch.AppendElement(1);
    outTree.Add("price", vpair);
    outTree.Add("$7.95", vpair);

    //<description>Light Belgian waffles covered with strawberries and whipped cream</description>
    vpair = branch.AppendElement(2);
    outTree.Add("description", vpair);
    outTree.Add("Light Belgian waffles covered with strawberries and whipped cream", vpair);

    //<calories>900</calories>
    vpair = branch.AppendElement(3);
    outTree.Add("calories", vpair);
    outTree.Add("900", vpair);

    A = outTree;
# ---------- end xml_test_data ----------
python = PythonScript()  # -> Out, A
txt = Text()
c_script = CSharpScript()  # -> out, A; inputs x: Int32
# ---------- c_script: C# ----------
    // Nearly all of this code started with examples posted by the fine folk helping each other at grasshopper3D.com.
    // (Afterwards, of course, it was mangled and modified to suit my particular purposes...)

    DataTree<System.Object> outTree = new DataTree<System.Object>();

    int someData = 0;

    // Make trunk path and an empty branch path to modify later
    GH_Path trunk = new GH_Path(0); // {0}
    GH_Path branch = new GH_Path(); // {}
    GH_Path vpair = new GH_Path(); //{}
    Print("Trunk path: " + trunk.ToString());

    // then add six branches...
    for(int i = 0; i < 6; i++) {
      branch = trunk.AppendElement(i);
      branch = branch.AppendElement(i);
      Print("Branch: " + branch.ToString());

      // ...with 4 items each
      for(int j = 0; j < 4; j++) {
        outTree.Add(someData++, branch);
      }
    }

    // Add a third level to that last branch with a null in it
    branch = branch.AppendElement(0);
    outTree.Add(null, branch);

    A = outTree;
# ---------- end c_script ----------
panel = Panel(xml_test_data.A)
panel_2 = Panel(c_script.A)
panel_3 = Panel(c_script.out)
# GHowl
# XML
xml = XmlParser(Path="E:\Users\scottd\Documents\architecture\simple.xml")  # -> Elements, Values, AttributeNames, AttributeValues, CData
item = ListItem(List=xml_test_data.A, Index=0, Wrap=True)
item_2 = ListItem(List=xml_test_data.A, Index=1, Wrap=True)
panel_4 = Panel(xml.Elements)
panel_5 = Panel(xml.Values)
panel_6 = Panel(item)
panel_7 = Panel(item_2)
# EleFront
# Attribute
attributes = DefineObjectAttributes(UserKeys=xml.Elements, UserValues=xml.Values)
# GH Key/Value
keysearch = KeyValueSearch(Keys=xml.Elements, Values=xml.Values, Search="price")
datatable = CreateDataTable()
# LunchBox DataTable
# GeomGym IFC tag
ggrvttp = GgRvtTextParameter(Name=xml.Elements, Text=xml.Values)
deatt = DeconstructAttributes(ReferencedGeometryOrAttributes=attributes)  # -> Keys, Values
panel_8 = Panel(deatt.Keys)
panel_9 = Panel(keysearch)
panel_10 = Panel(deatt.Values)
panel_11 = Panel(ggrvttp)
